# Grasshopper definition TERRENO_EXEMPLOS.gh (Grasshopper 1.0.7)

surface = Surface(<surface referenced from the Rhino model>)
deconstruct_brep = DeconstructBrep(Brep=surface)  # -> Faces, Edges, Vertices
number_slider = Slider(29, range=1..50)
construct_point = ConstructPoint(XCoordinate=0, YCoordinate=0, ZCoordinate=0)
divide_curve = DivideCurve(Curve=deconstruct_brep.Edges, Count=10, Kinks=False)  # -> flatten(Points), Tangents, Parameters
populate_geometry = PopulateGeometry(Geometry=surface, Count=Slider(56, range=2..300), Seed=Slider(3, range=2..100))
unit_z = UnitZ(Factor=number_slider)
suirify = Suirify(populate_geometry)
suirify_2 = Suirify(divide_curve.Points)
merge = Merge(Data1=suirify, Data2=suirify_2)
line = Line(StartPoint=construct_point, EndPoint=unit_z)
xy_plane = XYPlane(Origin=Point(0, 0, 0))
perp_frames = PerpFrames(Curve=line, Count=number_slider, Align=True)  # -> Frames, Parameters
delaunay_mesh = DelaunayMesh(Points=merge, Plane=PlaneXY(0, 0, 0))
delaunay_edges = DelaunayEdges(Points=merge, Plane=xy_plane)  # -> Connectivity, Edges
deconstruct = Deconstruct(Point=populate_geometry)  # -> XComponent, YComponent, ZComponent
mesh_plane = MeshPlane(Mesh=delaunay_mesh, Plane=perp_frames.Frames)
explode = Explode(Curve=mesh_plane, Recursive=True)  # -> Segments, Vertices
text_tag_3d = TextTag3D(Location=populate_geometry, Text=deconstruct.ZComponent, Size=1, Justification=7)
prune_tree = PruneTree(Tree=explode.Vertices, Minimum=4, Maximum=0)
interpolate = Interpolate(Vertices=prune_tree, Degree=3, Periodic=False, KnotStyle=1)  # -> Curve, Length, Domain
custom_preview = CustomPreview(Geometry=interpolate.Curve, Material=ColourSwatch(SwatchColor=RGB(0, 8, 255)))
