# Grasshopper definition TERRENO_EXEMPLOS.gh (Grasshopper 1.0.8)

surface = Surface(<surface referenced from the Rhino model>)

# ---- group: Pontos aleatórios
populate_geometry = PopulateGeometry(Geometry=surface, Count=Slider(104, range=2..300), Seed=Slider(37, range=2..100))

# ---- group: Isoplanos - Planos de corte
number_slider = Slider(29, range=1..50)
construct_point = ConstructPoint(XCoordinate=0, YCoordinate=0, ZCoordinate=0)
unit_z = UnitZ(Factor=number_slider)
line = Line(StartPoint=construct_point, EndPoint=unit_z)
perp_frames = PerpFrames(Curve=line, Count=number_slider, Align=True)  # -> Frames, Parameters

# ---- group: Pontos de borda
deconstruct_brep = DeconstructBrep(Brep=surface)  # -> Faces, Edges, Vertices
divide_curve = DivideCurve(Curve=deconstruct_brep.Edges, Count=10, Kinks=False)  # -> flatten(Points), Tangents, Parameters

# ---- group: Pontos totais
suirify = Suirify(populate_geometry)
suirify_2 = Suirify(divide_curve.Points)
merge = Merge(Data1=suirify, Data2=suirify_2)

# ---- group: Triangulação
xy_plane = XYPlane(Origin=Point(0, 0, 0))
delaunay_edges = DelaunayEdges(Points=merge, Plane=xy_plane)  # -> Connectivity, Edges

# ---- group: pontos em cada nível
delaunay_mesh = DelaunayMesh(Points=merge, Plane=PlaneXY(0, 0, 0))
mesh_plane = MeshPlane(Mesh=delaunay_mesh, Plane=perp_frames.Frames)

# ---- group: Cotas
deconstruct = Deconstruct(Point=populate_geometry)  # -> XComponent, YComponent, ZComponent
text_tag_3d = TextTag3D(Location=populate_geometry, Text=deconstruct.ZComponent, Size=1, Justification=7)

# ---- group: Curvas de nível
explode = Explode(Curve=mesh_plane, Recursive=True)  # -> Segments, Vertices
prune_tree = PruneTree(Tree=explode.Vertices, Minimum=4, Maximum=0)
interpolate = Interpolate(Vertices=prune_tree, Degree=3, Periodic=False, KnotStyle=1)  # -> Curve, Length, Domain
custom_preview = CustomPreview(Geometry=interpolate.Curve, Material=ColourSwatch(SwatchColor=RGB(0, 8, 255)))
